# Requirement set 0 best_requirements (R2017b)

## 1 [#7] MEP Measurement

## 2 [#8] Motor Hotspot Search
Priority: Low

## 3 [#9] Motor Threshold Hunting
Priority: Essential

## 4 [#10] MEP IOC
Priority: Medium

## 5 [#11] EEGTMS
Priority: High

## 6 [#12] rTMS Intervention

## 7 [#13] Multimodal Experiment

## 8 [#14] TEP Hotspot Search

## 9 [#15] TEP Measurement

## 10 [#16] TEP IOC

## 11 [#20] Multimodal Experiment

### 11.1 [#22] Interactive application
Priority: Essential

#### 11.1.1 [#23] Iconing of library
Priority: Essential

#### 11.1.2 [#29] interacting with axes to add pulses on any stimulator
Priority: Essential

#### 11.1.3 [#30] deleting a particularly added pulse
Priority: Essential

#### 11.1.4 [#31] deleting a particular added stimulator
Priority: Essential

#### 11.1.5 [#32] changing the Target chanel using the Global Channel Selector
The global channel selector pannel would save the data in a cell str format to the targetChannel string
Priority: Low

#### 11.1.6 [#33] callback based saving of the inputs data
Priority: Essential

#### 11.1.7 [#34] callback based reloading of the axes when measures are changed from listbox
Priority: Essential

### 11.2 [#24] MEP Measurement

### 11.3 [#25] IOC Measurement

### 11.4 [#26] Motor Thresholding

### 11.5 [#27] Psychometric Thresholding

### 11.6 [#28] EEGTMS