% Requirement links of BEST.m (R2017b)

% lines 1106-1110 links to 0 best_requirements.slreqx#23: Iconing of library
            obj.pi.mm.cond.btn=uicontrol( 'Parent', r4 ,'Style','PushButton','String','+','FontSize',16,'FontWeight','Bold','HorizontalAlignment','center','Tooltip','Click to Add a new Condition','Callback',@(~,~)obj.cb_pi_mm_conditions)%add condition
            obj.pi.mm.stim.btn=uicontrol( 'Parent', r4 ,'Style','PushButton','String','','FontWeight','Bold','HorizontalAlignment','center','Position',[0 0 1 1],'units','normalized','CData',obj.icons.stimulator,'Tooltip','Click to Add a new Stimulator on this Condition','Callback',@(~,~)obj.cb_pi_mm_stim); %add stimulator
            obj.pi.mm.sp.btn=uicontrol( 'Parent', r4 ,'Style','PushButton','String','','FontWeight','Bold','HorizontalAlignment','center','CData',obj.icons.single_pulse,'Tooltip','Click to Add a Single-Pulse on selected stimulator (selected stimulator is highlighted in blue colour)','Tag','single_pulse','Callback',@obj.cb_pi_mm_pulse); %add single pulse
            obj.pi.mm.pp.btn=uicontrol( 'Parent', r4 ,'Style','PushButton','String','','FontWeight','Bold','HorizontalAlignment','center','CData',obj.icons.paired_pulse,'Tooltip','Click to Add a Paired-Pulse on selected stimulator (selected stimulator is highlighted in blue colour)','Tag','paired_pulse','Callback',@obj.cb_pi_mm_pulse);%add burst or train
            obj.pi.mm.train.btn=uicontrol( 'Parent', r4 ,'Style','PushButton','String','','FontWeight','Bold','HorizontalAlignment','center','CData',obj.icons.train,'Tooltip','Click to Add a Train or Burst on selected stimulator (selected stimulator is highlighted in blue colour)','Tag','train','Callback',@obj.cb_pi_mm_pulse);%add paired pulse

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